# Grasshopper definition circle-definition.gh (Grasshopper 1.0.7)

# Adjust slot width in mm
number_slider = Slider(5, range=0..10)
# Adjust slot height in mm
number_slider_2 = Slider(3, range=0..10)
# Adjust circle radius in mm
number_slider_3 = Slider(89, range=0..100)
num = Number(-2)
rectangle = Rectangle(Plane=PlaneXY(0, 0, 0), XSize=number_slider, YSize=number_slider_2, Radius=0)  # -> Rectangle, Length
division = Division(A=number_slider, B=num)
subtraction = Subtraction(A=number_slider_3, B=number_slider_2)
vec = VectorXYZ(XComponent=division, YComponent=subtraction, ZComponent=0)  # -> Vector, Length
move = Move(Geometry=rectangle.Rectangle, Motion=vec.Vector)  # -> Geometry, Transform
# Adjust number of slots
number_slider_4 = Slider(52, range=0..75)
arrpolar = PolarArray(Geometry=move.Geometry, Plane=PlaneXY(0, 0, 0), Count=number_slider_4, Angle=6.283185307)  # -> Geometry, Transform
cir = Circle(Plane=PlaneXY(0, 0, 0), Radius=number_slider_3)
trim = TrimWithRegions(Curve=arrpolar.Geometry, Regions=cir)  # -> flatten(Inside), Outside
trim_2 = TrimWithRegions(Curve=cir, Regions=arrpolar.Geometry)  # -> Inside, Outside
join = JoinCurves(Curves=[trim.Inside, trim_2.Outside], Preserve=False)
